# Grasshopper definition template.gh (Grasshopper 1.0.7)

point = Point(Point(11.41988701, -2.263166674, 0))
point_2 = Point(Point(27.08620353, 8.412553153, 0))
point_3 = Point(Point(11.41988701, -2.263166674, 0))
point_4 = Point(Point(13.52932833, -1.104576932, 0))
# Don't forget to specify the input parameters' type hints
# If the error message mentions something about Guid object, then you forgot to set the type hints.
point_5 = Point(Point(11.41988701, -2.263166674, 0))
point_6 = Point(Point(11.41988701, -2.263166674, 0))
panel = Panel("Component with annotations")
panel_2 = Panel("Component with vectors")
ipy = GhPythonScript(source=point, target=point_2)  # -> messages, vectors, geometry; inputs source: Point3d, target: Point3d
# ---------- ipy: Python ----------
import math, random
from Rhino import RhinoApp, RhinoDoc
from Rhino.Geometry import *
from Rhino.Geometry.Intersect import *
from System.Drawing import Color

vectors = []
def Vec( point, direction, color ):
    vectors.append( [point, direction, color] )

Vec( source, target - source, Color.Blue )

geometry = []
# ---------- end ipy ----------
ipy_2 = GhPythonScript(source=point_3, target=point_4)  # -> messages, annotations, geometry; inputs source: Point3d, target: Point3d
# ---------- ipy_2: Python ----------
import math, random
from Rhino import RhinoApp, RhinoDoc
from Rhino.Geometry import *
from Rhino.Geometry.Intersect import *
from System.Drawing import Color

annotations = []
def Anno( point, label ):
    annotations.append( [point, label] )

Anno( source, 's' )
Anno( target, 't' )

geometry = []
# ---------- end ipy_2 ----------
# Rename the out parameter to messages. If you delete it by mistake you can restore it by right-clicking the components title and selecting show output parameter
# rename the second output parameter to geometry and create a list for emitting mixed-geometry objects.
ipy_3 = GhPythonScript(source=point_5, target=point_6)  # -> messages, geometry; inputs source: Point3d, target: Point3d
# ---------- ipy_3: Python ----------
import math, random
from Rhino import RhinoApp, RhinoDoc
from Rhino.Geometry import *
from Rhino.Geometry.Intersect import *
from System.Drawing import Color

geometry = []
# ---------- end ipy_3 ----------
vecs = Vecs(vectors=ipy.vectors)
anno = Anno(annotations=ipy_2.annotations, size=Slider(1, range=0..1))
panel_3 = Panel("Without bulk imports")
point_7 = Point(Point(11.41988701, -2.263166674, 0))
point_8 = Point(Point(11.41988701, -2.263166674, 0))
ipy_4 = GhPythonScript(source=point_7, target=point_8)  # -> messages, geometry; inputs source: Point3d, target: Point3d
# ---------- ipy_4: Python ----------
import math, random
from Rhino import RhinoApp, RhinoDoc
from Rhino.Geometry import ( Point3d, Vector3d, Plane, Transform,
    Interval, Point2d, Point3f, Vector3f, Point2f, Line, Circle, Curve,
    Surface, NurbsCurve, NurbsSurface, Brep, Mesh,  Arc, ArcCurve, 
    BezierCurve, Box, Cone, ControlPoint, Cylinder, Ellipse, Extrusion, 
    LineCurve, LoftType, Point4d, PointCloud, PolyCurve, Polyline, 
    PolylineCurve, Quaternion, Sphere )
from Rhino.Geometry.Intersect import Intersection
from System.Drawing import Color

geometry = []
# ---------- end ipy_4 ----------

# ==== cluster Vecs
vectors = ClusterInput()
py = GhPythonScript(vectors=vectors)  # -> points, directions, colors; inputs vectors: list
# ---------- py: Python ----------
points     = []
directions = []
colors     = []

for point, direction, color in vectors:
    points     .append( point     )
    directions .append( direction )
    colors     .append( color     )
# ---------- end py ----------
vector_display_ex = VectorDisplayEx(Point=py.points, Vector=py.directions, Colour=py.colors, Width=2)

# ==== cluster Anno
annotations = ClusterInput()
anno = GhPythonScript(annotations=annotations)  # -> points, labels; inputs annotations: list
# ---------- anno: Python ----------
points = []
labels = []
for point, label in annotations:
    points.append( point )
    labels.append( label )
# ---------- end anno ----------
size = ClusterInput()
text_tag_3d = TextTag3D(Location=anno.points, Text=anno.labels, Size=size, Justification=7)
